% Simulink design studies more_params_sweep.mldatx for model model

study "DesignStudy": 123 simulations
  combinatorial set (123 points):
    "Ft": Variable(Name=Ft), values 160:0.5:180 (41 points)
    "beta": Variable(Name=beta), values [0.2,0.05,0.8] (3 points)